# Grasshopper definition gh-csharp-basic.ghx (Grasshopper 1.0.7)
# plug-ins: ScriptParasite

range = Range(Domain=Domain(0, 1), Steps=10)
xy = XYPlane(Origin=Point(0, 0, 0))
deplane = DeconstructPlane(Plane=xy)  # -> Origin, XAxis, YAxis, ZAxis
pt = ConstructPoint(XCoordinate=range, YCoordinate=range, ZCoordinate=range)

spiral_staircase = CSharpScript(
    Plane=xy,
    Height="70",
    InnerRadius=Slider(50, range=0..100),
    OuterRadius=Slider(166, range=80..200),
    Steps=Slider(6, range=0..100),
    Turns=Slider(0.3, range=0..10),
    TooltipTextOverride="Spiral Staircase")  # -> out, Treads, Raisers; inputs Plane: Plane, Height: Double, InnerRadius: Double, OuterRadius: Double, Steps: Int32, Turns: Double
# ---------- spiral_staircase: C# usings ----------
using Rhino.DocObjects;
using Rhino.Collections;
using GH_IO;
using GH_IO.Serialization;
using System.IO;
using System.Xml;
using System.Xml.Linq;
using System.Linq;
using System.Data;
using System.Drawing;
using System.Reflection;
using System.Runtime.InteropServices;
# ---------- spiral_staircase: C# ----------
            var treads = new List<NurbsSurface>();
            var raisers = new List<NurbsSurface>();

            double stepHeight = Height / (Steps + 1);
            double stepAngle = Turns * Math.PI * 2 / Steps; // Angle in radians

            for (int i = 0; i <= Steps; i++)
            {
                var innerPoint = GetSpiralPoint(Plane, stepHeight * (i + 1), stepAngle * i, InnerRadius);
                var outerPoint = GetSpiralPoint(Plane, stepHeight * (i + 1), stepAngle * i, OuterRadius);

                var innerLowerPoint = GetSpiralPoint(Plane, stepHeight * (i + 1), stepAngle * (i + 1), InnerRadius);
                var outterLowerPoint = GetSpiralPoint(Plane, stepHeight * (i + 1), stepAngle * (i + 1), OuterRadius);

                var innerRaiserPoint = GetSpiralPoint(Plane, stepHeight * i, stepAngle * i, InnerRadius);
                var outterRaiserPoint = GetSpiralPoint(Plane, stepHeight * i, stepAngle * i, OuterRadius);

                var tread = NurbsSurface.CreateFromCorners(innerPoint, innerLowerPoint, outterLowerPoint, outerPoint);
                treads.Add(tread);

                var raiser = NurbsSurface.CreateFromCorners(innerPoint, outerPoint, outterRaiserPoint, innerRaiserPoint);
                raisers.Add(raiser);
            }
            Treads = treads;
            Raisers = raisers;
# ---------- spiral_staircase: C# additional code ----------
public Point3d GetSpiralPoint(Plane plane, double height, double angle, double radius)
        {
            double x = radius * Math.Cos(angle);
            double y = radius * Math.Sin(angle);
            double z = height;
            return plane.Origin + plane.XAxis * x + plane.YAxis * y + plane.ZAxis * z;
        }
# ---------- end spiral_staircase ----------
scriptpar = ScriptParasite(Enable=invert(False), Folder="\\vmware-host\Shared Folders\Escritorio\GrasshopperScripts")

polyline = CSharpScript(Points=pt)  # -> out, Polyline; inputs Points: list of Point3d
# ---------- polyline: C# ----------
            Polyline = new Polyline(Points);
            Point3d average = Point3d.Origin;
            foreach (var point in Points)
            {
                average += point;
            }
            average /= Points.Count;
            this.Print("Average point is " + average);
# ---------- end polyline ----------
scriptpar_2 = ScriptParasite(Enable=False, Folder="\\vmware-host\Shared Folders\Escritorio\GrasshopperScripts")

line = LineSDL(Start=deplane.Origin, Direction=[deplane.XAxis, deplane.YAxis, deplane.ZAxis], Length=Slider(10, range=0..10))
panel = Panel(polyline.out)
panel_2 = Panel(polyline.Polyline)
preview = CustomPreview(Geometry=spiral_staircase.Treads, Material=ColourSwatch(SwatchColor=RGB(163, 114, 0)))
preview_2 = CustomPreview(Geometry=spiral_staircase.Raisers, Material=ColourSwatch(SwatchColor=RGB(255, 255, 255)))
